% Simulink data dictionary asdSkyHogg_Data.sldd
% references interfaces.sldd

thottleValue = Simulink.VariantVariable(
  struct(
    Choices=[struct(Condition="HighFidelityPropulsion", Value=0.95), struct(Condition="LowFidelityPropulsion", Value=0.5)],
    Specification=[],
    Bank=[]))

HighFidelityPropulsion = Simulink.VariantExpression(Condition="useHighFidelityPropulsion == true")
LowFidelityPropulsion = Simulink.VariantExpression(Condition="useHighFidelityPropulsion == false")

useHighFidelityPropulsion = Simulink.VariantControl(
  Value=Simulink.Parameter(Value=false, DataType="boolean"),
  ActivationTime="update diagram",
  ValueType="Simulink.Parameter")