% Simulink data dictionary interfaces.sldd

ActuatorCmdBus = Simulink.Bus()
  Aileron: double
  Elevator: double
  Rudder: double

PilotCmdBus = Simulink.Bus()
  aileron: single
  elevator: single
  throttle: double
  AltCmd: double
  rudder: single

SensorDataBus = Simulink.Bus()
  ActPositions: Bus: ActPositionsBus
  bodyAngles: Bus: BodyAnglesBus
  alpha: double
  beta: double
  alphadot: double
  betadot: double
  h_sensed: double
  airSpeedCalibrated: double

ActPositionsBus = Simulink.Bus()
  Aileron: double
  Elevator: double
  Rudder: double

BodyAnglesBus = Simulink.Bus()
  phi: double
  theta: double
  psi: double

PlantDataBus = Simulink.Bus()
  lat: double
  lon: double
  alt: double
  Ve: double[3]
  Xe: double[3]
  bodyAngles: Bus: BodyAnglesBus
  DCM: double[3 3]
  Vb: double[3]
  alpha: double
  beta: double
  alphadot: double
  betadot: double
  w: double[3]
  wdot: double[3]
  Ab: double[3]
  WindAngularRates: double[3]
  ActPositions: Bus: ActPositionsBus